# Grasshopper definition 20241113_From the PC.gh (Grasshopper 1.0.8)
# plug-ins: Karamba3D

brep = Brep(<brep referenced from the Rhino model>)
linetobeam = LineToBeamKaramba3D(
    New=True,
    Remove=True,
    LimitDistance_m=0.005,
    Bending=True,
    SetBucklingLength=True,
    ToPolylineMaxAngle=0.03,
    ToPolylineTolerance=0.01,
    ToPolylineMaxEdgeLength=0.25)  # -> Element, Points, Info
crv = Curve(<curve referenced from the Rhino model>)
divide = DivideCurve(Curve=crv, Count=Slider(34, range=0..100), Kinks=False)  # -> Points, Tangents, Parameters
meshtoshell = MeshToShellKaramba3D(Mesh=brep, LimitDistance_m=0.005)  # -> Element, Points, Info
matselect = MaterialSelectionKaramba3D(menu=[dropdown(0), dropdown(0)])
cross_section = CrossSectionKaramba3D(
    FamilyNameOfCrossSection="DefaultCroSec",
    Height_cm=9.6,
    UpperFlangeWidth_cm=10,
    LowerFlangeWidth_cm=10,
    UpperFlangeThickness_cm=0.8,
    LowerFlangeThickness_cm=0.8,
    WebThickness_cm=0.5,
    FilletRadius_cm=0,
    mode="I")
loads = LoadsKaramba3D(Vector=Vector(0, 0, -1), LCase="0", mode="Gravity")
element = ElementKaramba3D(meshtoshell.Element)
assemble = AssembleModelKaramba3D(Elem=element, Load=loads, CrossSection=cross_section, Material=matselect, LimitDistance_m=0.005)  # -> Model, Info, Mass_kg, CenterOfGravity, LoadCaseNames
analyze = AnalyzeKaramba3D(Model=assemble.Model)  # -> CalculatedModel, MaximumDisplacement_cm, ResultingForceOfGravity_kN, ElasticEnergyChange_kNm
